# Grasshopper definition async_mesh_AA_20200717.gh (Grasshopper 1.0.7)

point = Point(Point(18.30137181, 1.398844795, 0))
mesh_sphere = MeshSphere(Base=point, Radius=5, UCount=10, VCount=20)

ghpython_script = GhPythonScript(file="C:/dev/async-test/input.json", mesh=mesh_sphere)  # -> out, file; inputs mesh: Mesh
# ---------- ghpython_script: Python ----------
from ostate.util import rhino_json

rhino_json.serialize(mesh, file)
# ---------- end ghpython_script ----------
panel = Panel(ghpython_script.file)
panel_2 = Panel("C:/dev/async-test/output.json")
ghpython_script_2 = GhPythonScript(hidden=Toggle(True), script="C:/dev/async-test/mesh.py", input=panel, output=panel_2)  # -> out; inputs hidden: Boolean
# ---------- ghpython_script_2: Python ----------
import subprocess

if hidden:
    interpreter = 'pythonw'
else:
    interpreter = 'python'

cmd = '%s %s %s %s' % (interpreter, script, input, output)
subprocess.Popen(cmd)
# ---------- end ghpython_script_2 ----------
file_path = FilePath(panel_2)
ghpython_script_3 = GhPythonScript(file=file_path)  # -> out, mesh
# ---------- ghpython_script_3: Python ----------
from ostate.util import rhino_json

mesh = rhino_json.deserialize(file)
# ---------- end ghpython_script_3 ----------
mesh = Mesh(ghpython_script_3.mesh)
