# Grasshopper definition async_text.gh (Grasshopper 1.0.7)

input = Panel("This string will be capitalized.")

ghpython_script = GhPythonScript(file="C:/dev/async-test/input.txt", content=input)  # -> out, file
# ---------- ghpython_script: Python ----------
with open(file, 'w') as writer:
    writer.write(str(content))
# ---------- end ghpython_script ----------
panel = Panel(ghpython_script.file)
panel_2 = Panel("C:/dev/async-test/output.txt")
ghpython_script_2 = GhPythonScript(script="C:/dev/async-test/text.py", input=panel, output=panel_2)  # -> out
# ---------- ghpython_script_2: Python ----------
import subprocess

cmd = 'pythonw %s %s %s' % (script, input, output)
subprocess.Popen(cmd)
# ---------- end ghpython_script_2 ----------
file_path = FilePath(panel_2)
ghpython_script_3 = GhPythonScript(file=file_path)  # -> out, content
# ---------- ghpython_script_3: Python ----------
with open(file, 'r') as reader:
    content = reader.read()
# ---------- end ghpython_script_3 ----------
output = Panel(ghpython_script_3.content)
