# Grasshopper definition async_text_AA_20200717.gh (Grasshopper 1.0.7)

python = PythonScript()  # -> path
# ---------- python: Python ----------
import pickle

import sys
sys.path.append(path)

path = ghenv.LocalScope.ghdoc.Path
path = path.split("\\")
path = "\\".join(path[:-1]) + "\\"
# ---------- end python ----------
concat = Concatenate(FragmentA=python, FragmentB="text.py")
panel = Panel(concat)

panel_2 = Panel("C:/dev/async-test/input.txt")
input = Panel("This string will be capitalized.")

python_2 = GhPythonScript(file=panel, content=input)  # -> out, file
# ---------- python_2: Python ----------
with open(file, 'w') as writer:
    writer.write(str(content))
# ---------- end python_2 ----------
panel_3 = Panel("C:/dev/async-test/text.py")
panel_4 = Panel(python_2.file)
panel_5 = Panel("C:/dev/async-test/output.txt")
python_3 = GhPythonScript(script=panel, input=panel_4, output=panel)  # -> out
# ---------- python_3: Python ----------
import subprocess

cmd = 'pythonw %s %s %s' % (script, input, output)
subprocess.Popen(cmd)
# ---------- end python_3 ----------
path = FilePath(panel)
python_4 = GhPythonScript(file=path)  # -> out, content
# ---------- python_4: Python ----------
with open(file, 'r') as reader:
    content = reader.read()
# ---------- end python_4 ----------
output = Panel(python_4.content)
